# Dynamo graph GenerateConfigurations - Hangers.dyn (Dynamo 2.0.3.8810)

file_path = Filename("C:\Users\mmendez\Personal\AU2019\Application\configurationMapping\HangerMapping.txt")  # graph input
code_block = CodeBlock { "-"; "100"; }
code_block_2 = CodeBlock()
# ---------- code_block_2.designscript (11 lines) ----------
["1-5/8\" Facing Up"];

strutWidths=12..24..12;
strutWidths + "\"";

["3/8\"","1/2\""];

rodLengths=12..24..12;
rodLengths + "\"";

["1 Tier"];
# ----------------------------------------
create = List.Create(item0=code_block_2.out0, item1=code_block_2.out2, item2=code_block_2.out3, item3=code_block_2.out5, item4=code_block_2.out6)
count = List.Count(list=create@L2)
sequence = Sequence(amount=count)
allCombinations = Python(IN[0]=sequence)
# ---------- allCombinations.python (44 lines) ----------
import clr
clr.AddReference('ProtoGeometry')
from Autodesk.DesignScript.Geometry import *

clr.AddReference("RevitNodes")
import Revit
clr.ImportExtensions(Revit.Elements)
clr.ImportExtensions(Revit.GeometryConversion)

clr.AddReference("RevitServices")
import RevitServices
from RevitServices.Persistence import DocumentManager
from RevitServices.Transactions import TransactionManager
from System.Collections.Generic import *

clr.AddReference("RevitAPI")
import Autodesk
from Autodesk.Revit.DB import *

import System
from System.Collections.Generic import *

doc = DocumentManager.Instance.CurrentDBDocument

#The inputs to this node will be stored as a list in the IN variables.
dataEnteringNode = IN

all_codes = []
def AddToCode(current, code):
	global all_codes 
	head = current[0]
	rest = current[1:]
	for e in head:
		new = code + "," + str(e) if e != "" else str(e)
		if len(rest) > 0:
			AddToCode(rest, new)
		else:
			all_codes.append(new)
	return None

AddToCode(IN[0], "")

#Assign your output to the OUT variable.
OUT = all_codes
# ----------------------------------------
code_block_3 = CodeBlock { ","; }
split = String.Split(str=allCombinations, separater0=code_block_3)
join = String.Join(separator=code_block.out0, string0=split)
firstItem = List.FirstItem(list=join)
select_model_element = DSModelElementSelection()  # 1 picked in the model
elementType = Element.ElementType(element=select_model_element)
code_block_4 = CodeBlock { "Strut Size"; "Strut Width"; "Rod Size"; "Rod Length"; "Tiers"; }
create_2 = List.Create(item0=code_block_4.out0, item1=code_block_4.out1, item2=code_block_4.out2, item3=code_block_4.out3, item4=code_block_4.out4)
allCombinations_2 = Python(IN[0]=create)  # same code as allCombinations
code_block_5 = CodeBlock { ","; }
split_2 = String.Split(str=allCombinations_2, separater0=code_block_5)
python_script = Python(IN[0]=split_2, IN[1]=create)
# ---------- python_script.python (16 lines) ----------
import clr
clr.AddReference('ProtoGeometry')
from Autodesk.DesignScript.Geometry import *
#The inputs to this node will be stored as a list in the IN variables.
dataEnteringNode = IN

all_list = []
for i, e in enumerate(IN[0]):
	temp_list = []
	for k, j in enumerate(e):
		index_of = IN[1][k].index(j)
		temp_list.append(index_of)
	all_list.append(temp_list)

#Assign your output to the OUT variable.
OUT = all_list
# ----------------------------------------
getFamily = FamilyInstance.GetFamily(familyInstance=select_model_element)
parameterByName = Parameter.ParameterByName(element=select_model_element, name=code_block_4.out0)
id = Parameter.Id(parameter=parameterByName)
nestedFamilyTypes = Python(IN[0]=getFamily, IN[1]=id)  # "Family.NestedFamilyTypes"
# ---------- nestedFamilyTypes.python (33 lines) ----------
import clr
clr.AddReference('ProtoGeometry')
from Autodesk.DesignScript.Geometry import *

clr.AddReference("RevitNodes")
import Revit
clr.ImportExtensions(Revit.Elements)
clr.ImportExtensions(Revit.GeometryConversion)

clr.AddReference("RevitServices")
import RevitServices
from RevitServices.Persistence import DocumentManager
from RevitServices.Transactions import TransactionManager
from System.Collections.Generic import *

clr.AddReference("RevitAPI")
import Autodesk
from Autodesk.Revit.DB import *

import System
from System.Collections.Generic import *

doc = DocumentManager.Instance.CurrentDBDocument

#The inputs to this node will be stored as a list in the IN variables.
dataEnteringNode = IN
family = UnwrapElement(IN[0])
family_type_id = ElementId(IN[1])

nested_type_ids = family.GetFamilyTypeParameterValues(family_type_id)

#Assign your output to the OUT variable.
OUT = [doc.GetElement(id) for id in nested_type_ids]
# ----------------------------------------

# group: Build Strut Size MTS Options
name = Element.Name(element=nestedFamilyTypes)
contains = List.Contains(list=code_block_2.out0, item=name, lacing=Longest)
filterByBoolMask = List.FilterByBoolMask(list=nestedFamilyTypes, mask=contains)

parameterByName_2 = Parameter.ParameterByName(element=select_model_element, name=code_block_4.out1)
id_2 = Parameter.Id(parameter=parameterByName_2)
nestedFamilyTypes_2 = Python(IN[0]=getFamily, IN[1]=id_2)  # "Family.NestedFamilyTypes"; same code as nestedFamilyTypes

# group: Build Strut Width MTS Options
name_2 = Element.Name(element=nestedFamilyTypes_2)
contains_2 = List.Contains(list=code_block_2.out2, item=name_2, lacing=Longest)
filterByBoolMask_2 = List.FilterByBoolMask(list=nestedFamilyTypes_2, mask=contains_2)

parameterByName_3 = Parameter.ParameterByName(element=select_model_element, name=code_block_4.out2)
id_3 = Parameter.Id(parameter=parameterByName_3)
nestedFamilyTypes_3 = Python(IN[0]=getFamily, IN[1]=id_3)  # "Family.NestedFamilyTypes"; same code as nestedFamilyTypes

# group: Build Rod Size MTS Options
name_3 = Element.Name(element=nestedFamilyTypes_3)
contains_3 = List.Contains(list=code_block_2.out3, item=name_3, lacing=Longest)
filterByBoolMask_3 = List.FilterByBoolMask(list=nestedFamilyTypes_3, mask=contains_3)

parameterByName_4 = Parameter.ParameterByName(element=select_model_element, name=code_block_4.out3)
id_4 = Parameter.Id(parameter=parameterByName_4)
nestedFamilyTypes_4 = Python(IN[0]=getFamily, IN[1]=id_4)  # "Family.NestedFamilyTypes"; same code as nestedFamilyTypes

# group: Build Rod Length MTS Options
name_4 = Element.Name(element=nestedFamilyTypes_4)
contains_4 = List.Contains(list=code_block_2.out5, item=name_4, lacing=Longest)
filterByBoolMask_4 = List.FilterByBoolMask(list=nestedFamilyTypes_4, mask=contains_4)

parameterByName_5 = Parameter.ParameterByName(element=select_model_element, name=code_block_4.out4)
id_5 = Parameter.Id(parameter=parameterByName_5)
nestedFamilyTypes_5 = Python(IN[0]=getFamily, IN[1]=id_5)  # "Family.NestedFamilyTypes"; same code as nestedFamilyTypes

# group: Build Rod Length MTS Options
name_5 = Element.Name(element=nestedFamilyTypes_5)
contains_5 = List.Contains(list=code_block_2.out6, item=name_5, lacing=Shortest)
filterByBoolMask_5 = List.FilterByBoolMask(list=nestedFamilyTypes_5, mask=contains_5, lacing=Longest)

create_3 = List.Create(item0=filterByBoolMask.in, item1=filterByBoolMask_2.in, item2=filterByBoolMask_3.in, item3=filterByBoolMask_4.in, item4=filterByBoolMask_5.in)
python_script_2 = Python(IN[0]=python_script, IN[1]=create_3)
# ---------- python_script_2.python (15 lines) ----------
import clr
clr.AddReference('ProtoGeometry')
from Autodesk.DesignScript.Geometry import *
#The inputs to this node will be stored as a list in the IN variables.
dataEnteringNode = IN

all_list = []
for e in IN[0]:
	temp_list = []
	for i, sub_e in enumerate(e):
		temp_list.append(IN[1][i][sub_e])
	all_list.append(temp_list)

#Assign your output to the OUT variable.
OUT = all_list
# ----------------------------------------
python_script_3 = Python(IN[0]=elementType, IN[1]=create_2, IN[2]=python_script_2)
# ---------- python_script_3.python (45 lines) ----------
import clr
clr.AddReference('ProtoGeometry')
from Autodesk.DesignScript.Geometry import *

clr.AddReference("RevitNodes")
import Revit
clr.ImportExtensions(Revit.Elements)
clr.ImportExtensions(Revit.GeometryConversion)

clr.AddReference("RevitServices")
import RevitServices
from RevitServices.Persistence import DocumentManager
from RevitServices.Transactions import TransactionManager
from System.Collections.Generic import *

clr.AddReference("RevitAPI")
import Autodesk
from Autodesk.Revit.DB import *
from Autodesk.Revit.DB.Structure import *

import System
from System.Collections.Generic import *

doc = DocumentManager.Instance.CurrentDBDocument

#The inputs to this node will be stored as a list in the IN variables.
dataEnteringNode = IN

family_symbol = UnwrapElement(IN[0])
parameter_names = IN[1]
all_parameter_values = UnwrapElement(IN[2])

new_instances = []
for i, parameter_values in enumerate(all_parameter_values):
	TransactionManager.Instance.EnsureInTransaction(doc)
	new_instance = doc.Create.NewFamilyInstance(XYZ(0,0,0), family_symbol, StructuralType.NonStructural)
	for parameter_name, parameter_value in zip(parameter_names, parameter_values):
		parameter = new_instance.LookupParameter(parameter_name)
		if not (parameter.IsReadOnly):
			parameter.Set(parameter_value.Id)
	new_instances.append(new_instance)
	TransactionManager.Instance.TransactionTaskDone()

#Assign your output to the OUT variable.
OUT = new_instances
# ----------------------------------------
python_script_4 = Python(IN[0]=python_script_3)
# ---------- python_script_4.python (36 lines) ----------
import clr
clr.AddReference('ProtoGeometry')
from Autodesk.DesignScript.Geometry import *

clr.AddReference("RevitNodes")
import Revit
clr.ImportExtensions(Revit.Elements)
clr.ImportExtensions(Revit.GeometryConversion)

clr.AddReference("RevitServices")
import RevitServices
from RevitServices.Persistence import DocumentManager
from RevitServices.Transactions import TransactionManager
from System.Collections.Generic import *

clr.AddReference("RevitAPI")
import Autodesk
from Autodesk.Revit.DB import *
from Autodesk.Revit.DB.Structure import *

import System
from System.Collections.Generic import *

doc = DocumentManager.Instance.CurrentDBDocument

#The inputs to this node will be stored as a list in the IN variables.
dataEnteringNode = IN

instances = UnwrapElement(IN[0])

guids = []
for instance in instances:
	guids.append([instance.UniqueId])

#Assign your output to the OUT variable.
OUT = guids
# ----------------------------------------
create_4 = List.Create(item0=firstItem, item1=python_script_4)
transpose = List.Transpose(lists=create_4)
createConfigurationMapping = Python(IN[0]=transpose)
# ---------- createConfigurationMapping.python (14 lines) ----------
import clr
clr.AddReference('ProtoGeometry')
from Autodesk.DesignScript.Geometry import *
#The inputs to this node will be stored as a list in the IN variables.
dataEnteringNode = IN

dict = {}
for i in IN[0]:
	assembly_code = i[0]
	unique_ids = i[1]
	dict[assembly_code] = unique_ids

#Assign your output to the OUT variable.
OUT = str(dict)
# ----------------------------------------
list_create = List.Create(item0=create_2, item1=sequence, item2=create)
transpose_2 = List.Transpose(lists=list_create)
createControls = Python(IN[0]=transpose_2)
# ---------- createControls.python (17 lines) ----------
import clr
clr.AddReference('ProtoGeometry')
from Autodesk.DesignScript.Geometry import *
#The inputs to this node will be stored as a list in the IN variables.
dataEnteringNode = IN

controls = []
for i in IN[0]:
	control = {'name': i[0], 'options':[]}
	values = i[1]
	texts = i[2]
	for value, text in zip(values, texts):
		control['options'].append({'value': value, 'text': text})
	controls.append(control)

#Assign your output to the OUT variable.
OUT = str(controls)
# ----------------------------------------
byList = Python(IN[0]=createConfigurationMapping, IN[1]=createControls)  # "JSON.ByList"
# ---------- byList.python (11 lines) ----------
import clr
clr.AddReference('ProtoGeometry')
from Autodesk.DesignScript.Geometry import *
#The inputs to this node will be stored as a list in the IN variables.
dataEnteringNode = IN

configuration_mapping = IN[0]
controls = IN[1]

#Assign your output to the OUT variable.
OUT = str({'detail': {'configurationMapping': eval(IN[0]), 'controls': eval(IN[1])}})
# ----------------------------------------
writeText = FileSystem.WriteText(filePath=file_path, text=byList)
code_block_6 = CodeBlock { "EX_Assembly_Number"; }
setParameterByName = Element.SetParameterByName(element=python_script_3, parameterName=code_block_6, value=firstItem)
code_block_7 = CodeBlock { [0,1]; }
getItemAtIndex = List.GetItemAtIndex(list=python_script_2, index=code_block_7)
watch = Watch(code_block_2.out3)
